# Grasshopper definition convert.gh (Grasshopper 1.0.8)

# CONVERT TO OUTPUT
panel = Panel("C:\Users\nbarnes\Documents\GitHub\directive-engine\datasets\museum_facade_v0_1\directive_engine_export")
objects = QueryModelObjects(Layer="DE_MODEL::MULLIONS", Locked=True, Hidden=True, AutoUpdateState=True)  # -> Objects, BlockInstances, Points, PointClouds, Curves, Surfaces, Extrusions, Breps
objects_2 = QueryModelObjects(Layer="DE_SCAN::ANCHORS", Locked=True, Hidden=True, AutoUpdateState=True)  # -> Objects, BlockInstances, Points
objects_3 = QueryModelObjects(Layer="DE_MODEL::ANCHORS", Locked=True, Hidden=True, AutoUpdateState=True)  # -> Objects, BlockInstances, Points, PointClouds, Curves, Surfaces, Extrusions, Breps
order = OrderContent(Content=objects.Curves)  # -> Content, Values
order_2 = OrderContent(Content=objects_2.Points)  # -> Content, Values
order_3 = OrderContent(Content=objects_3.Points)  # -> Content, Values
order_4 = OrderContent(Content=objects_3.Breps)  # -> Content, Values
data = Data(order.Content)
data_2 = Data(order.Values)
data_3 = Data(order_2.Content)
data_4 = Data(order_2.Values)
data_5 = Data(order_3.Content)
data_6 = Data(order_3.Values)
data_7 = Data(order_4.Content)
end = EndPoints(Curve=data)  # -> Start, End
ln = Line(StartPoint=end.Start, EndPoint=end.End)
vec = Vector("25,25,25")
c_script = CSharpScript(
    Write=Toggle(False),
    OutputDir=panel,
    AnchorIds=data_6,
    AnchorsModel=data_5,
    AnchorsScan=data_3,
    NominalLines=ln,
    PoseConfidence=Slider(0.8, range=0..1),
    DefaultMaxTranslateAbs_mm=vec,
    DefaultTranslationTol_mm=Slider(2, range=0..10),
    DefaultRotationTol_deg=Slider(0.5, range=0..1),
    DefaultConfidenceThreshold=Slider(0.5, range=0..1))  # -> out, RawJsonPath, ConstraintsJsonPath, Log, Success; inputs Write: Boolean, OutputDir: String, DatasetId: String, AnchorIds: list of String, AnchorsModel: list of Point3d, AnchorsScan: list of Point3d, PartIds: list of String, NominalLines: list, ScanLines: list, PoseConfidence: list of Double, DefaultMaxTranslateAbs_mm: Vector3d, DefaultTranslationTol_mm: Double, DefaultRotationTol_deg: Double, DefaultConfidenceThreshold: Double, AllowedTranslationAxes_Override: list of Vector3d, MaxTranslateAbs_mm_Override: list of Vector3d, TranslationTol_mm_Override: list of Double, RotationTol_deg_Override: list of Double, ConfidenceThreshold_Override: list of Double
# ---------- c_script: C# ----------
#region Usings
using System;
using System.Collections.Generic;
using System.Globalization;
using System.IO;
using System.Linq;
using System.Reflection;
using System.Text;

using Rhino;
using Rhino.Geometry;

using Grasshopper.Kernel;
using Grasshopper.Kernel.Types;
#endregion

public class Script_Instance : GH_ScriptInstance
{
  private const int NUM_DECIMALS = 3;

  private void RunScript(
		bool Write,
		string OutputDir,
		string DatasetId,
		List<string> AnchorIds,
		List<Point3d> AnchorsModel,
		List<Point3d> AnchorsScan,
		List<string> PartIds,
		List<object> NominalLines,
		List<object> ScanLines,
		List<double> PoseConfidence,
		Vector3d DefaultMaxTranslateAbs_mm,
		double DefaultTranslationTol_mm,
		double DefaultRotationTol_deg,
		double DefaultConfidenceThreshold,
		List<Vector3d> AllowedTranslationAxes_Override,
		List<Vector3d> MaxTranslateAbs_mm_Override,
		List<double> TranslationTol_mm_Override,
		List<double> RotationTol_deg_Override,
		List<double> ConfidenceThreshold_Override,
		ref object RawJsonPath,
		ref object ConstraintsJsonPath,
		ref object Log,
		ref object Success)
  {
    var log = new StringBuilder();
    bool ok = true;

    AnchorIds = AnchorIds ?? new List<string>();
    AnchorsModel = AnchorsModel ?? new List<Point3d>();
    AnchorsScan = AnchorsScan ?? new List<Point3d>();

    PartIds = PartIds ?? new List<string>();
    NominalLines = NominalLines ?? new List<object>();
    ScanLines = ScanLines ?? new List<object>();

    PoseConfidence = PoseConfidence ?? new List<double>();

    AllowedTranslationAxes_Override = AllowedTranslationAxes_Override ?? new List<Vector3d>();
    MaxTranslateAbs_mm_Override = MaxTranslateAbs_mm_Override ?? new List<Vector3d>();
    TranslationTol_mm_Override = TranslationTol_mm_Override ?? new List<double>();
    RotationTol_deg_Override = RotationTol_deg_Override ?? new List<double>();
    ConfidenceThreshold_Override = ConfidenceThreshold_Override ?? new List<double>();

    // Resolve OutputDir
    string outDir = (OutputDir ?? "").Trim();
    if (string.IsNullOrWhiteSpace(outDir))
    {
      string baseDir = Environment.GetFolderPath(Environment.SpecialFolder.DesktopDirectory);
      try
      {
        if (RhinoDoc.ActiveDoc != null && !string.IsNullOrWhiteSpace(RhinoDoc.ActiveDoc.Path))
        {
          var docDir = Path.GetDirectoryName(RhinoDoc.ActiveDoc.Path);
          if (!string.IsNullOrWhiteSpace(docDir) && Directory.Exists(docDir))
            baseDir = docDir;
        }
      }
      catch { }

      outDir = Path.Combine(baseDir, "directive_engine_export");
      log.AppendLine("[WARN] OutputDir was empty. Using: " + outDir);
    }

    try { Directory.CreateDirectory(outDir); }
    catch (Exception ex)
    {
      ok = false;
      log.AppendLine("[ERROR] Could not create OutputDir: " + outDir);
      log.AppendLine("        " + ex.Message);
    }

    string rawPath = Path.Combine(outDir, "museum_raw.json");
    string constraintsPath = Path.Combine(outDir, "museum_constraints.json");

    // DatasetId
    string datasetId = (DatasetId ?? "").Trim();
    if (string.IsNullOrWhiteSpace(datasetId))
    {
      datasetId = "museum_dataset_" + DateTime.UtcNow.ToString("yyyyMMdd_HHmmss", CultureInfo.InvariantCulture);
      log.AppendLine("[WARN] DatasetId was empty. Generated: " + datasetId);
    }

    // Anchors validation
    if (AnchorsModel.Count < 3 || AnchorsScan.Count < 3)
    {
      ok = false;
      log.AppendLine("[ERROR] Need at least 3 anchors in BOTH AnchorsModel and AnchorsScan.");
    }
    if (AnchorsModel.Count != AnchorsScan.Count)
    {
      ok = false;
      log.AppendLine("[ERROR] Anchor count mismatch: AnchorsModel=" + AnchorsModel.Count + ", AnchorsScan=" + AnchorsScan.Count);
    }

    int nAnch = Math.Min(AnchorsModel.Count, AnchorsScan.Count);

    if (AnchorIds.Count == 0 && nAnch > 0)
    {
      for (int i = 0; i < nAnch; i++) AnchorIds.Add("A" + (i + 1).ToString("D2"));
      log.AppendLine("[INFO] AnchorIds not provided. Generated A01..");
    }
    else if (AnchorIds.Count != nAnch)
    {
      ok = false;
      log.AppendLine("[ERROR] AnchorIds.Count must be 0 or " + nAnch + ". Got " + AnchorIds.Count + ".");
    }

    if (!EnsureUniqueNonEmpty(AnchorIds, "anchor_id", log)) ok = false;

    // Coerce nominal lines (Objects -> geometry -> line)
    List<Line> nominalLines = CoerceLines(NominalLines, "NominalLines", log, requireNonEmpty: true, ref ok);
    int nParts = nominalLines.Count;

    if (nParts == 0)
    {
      ok = false;
      log.AppendLine("[ERROR] NominalLines produced 0 valid lines.");
    }

    // Part IDs
    if (PartIds.Count == 0 && nParts > 0)
    {
      for (int i = 0; i < nParts; i++)
        PartIds.Add("MULLION_" + (i + 1).ToString("D4"));
      log.AppendLine("[INFO] PartIds not provided. Generated MULLION_0001..");
    }
    else if (PartIds.Count != nParts)
    {
      ok = false;
      log.AppendLine("[ERROR] PartIds.Count must be 0 or equal to NominalLines count (" + nParts + "). Got " + PartIds.Count + ".");
    }

    if (!EnsureUniqueNonEmpty(PartIds, "part_id", log)) ok = false;

    // PoseConfidence broadcast
    var poseConf = BroadcastDoubles(PoseConfidence, nParts, 1.0, "PoseConfidence", log, ref ok)
      .Select(Clamp01).ToList();

    // Units -> mm scale (output only)
    double scaleToMm = 1.0;
    try
    {
      if (RhinoDoc.ActiveDoc != null)
        scaleToMm = RhinoMath.UnitScale(RhinoDoc.ActiveDoc.ModelUnitSystem, UnitSystem.Millimeters);
    }
    catch { scaleToMm = 1.0; }
    log.AppendLine("[INFO] Unit scale to mm: " + scaleToMm.ToString("0.########", CultureInfo.InvariantCulture));

    // Scan lines:
    // - if provided, coerce & validate count
    // - else synthesize by transforming nominal lines using anchor-based rigid transform model->scan
    List<Line> scanLines = new List<Line>();
    bool scanProvided = (ScanLines != null && ScanLines.Count > 0);

    if (scanProvided)
    {
      scanLines = CoerceLines(ScanLines, "ScanLines", log, requireNonEmpty: true, ref ok);
      if (scanLines.Count != nParts)
      {
        ok = false;
        log.AppendLine("[ERROR] ScanLines count must match NominalLines. Nominal=" + nParts + ", Scan=" + scanLines.Count);
      }
    }
    else
    {
      if (nAnch < 3)
      {
        ok = false;
        log.AppendLine("[ERROR] Cannot synthesize ScanLines because anchors are insufficient.");
      }
      else
      {
        double rms;
        Transform T_scan_model = ComputeRigidTransform_ModelToScan(AnchorsModel, AnchorsScan, out rms);

        log.AppendLine("[WARN] ScanLines not provided. Synthesizing scan_line_mm by transforming nominal lines with anchor-based T_scan_model.");
        log.AppendLine("[INFO] Anchor-fit RMS (model→scan) in doc units: " + rms.ToString("0.###", CultureInfo.InvariantCulture));

        for (int i = 0; i < nominalLines.Count; i++)
        {
          var ln = nominalLines[i];
          var a = ln.From; a.Transform(T_scan_model);
          var b = ln.To;   b.Transform(T_scan_model);
          scanLines.Add(new Line(a, b));
        }
      }
    }

    if (!ok)
    {
      RawJsonPath = rawPath;
      ConstraintsJsonPath = constraintsPath;
      Log = log.ToString();
      Success = false;
      return;
    }

    // Defaults
    Vector3d defaultMaxAbs = DefaultMaxTranslateAbs_mm;
    if (defaultMaxAbs.IsZero) defaultMaxAbs = new Vector3d(25, 25, 25);
    defaultMaxAbs = new Vector3d(Math.Abs(defaultMaxAbs.X), Math.Abs(defaultMaxAbs.Y), Math.Abs(defaultMaxAbs.Z));

    double defaultTransTol = DefaultTranslationTol_mm <= 0 ? 2.0 : Math.Abs(DefaultTranslationTol_mm);
    double defaultRotTol = DefaultRotationTol_deg < 0 ? 0.5 : Math.Abs(DefaultRotationTol_deg);
    double defaultConfThr = DefaultConfidenceThreshold <= 0 ? 0.6 : Clamp01(DefaultConfidenceThreshold);

    // Overrides (empty/1/N)
    var allowAxes = BroadcastVectors(AllowedTranslationAxes_Override, nParts, new Vector3d(1, 1, 1), "AllowedTranslationAxes_Override", log, ref ok);
    var maxAbsPerPart = BroadcastVectors(MaxTranslateAbs_mm_Override, nParts, defaultMaxAbs, "MaxTranslateAbs_mm_Override", log, ref ok)
      .Select(v => new Vector3d(Math.Abs(v.X), Math.Abs(v.Y), Math.Abs(v.Z))).ToList();

    var transTolPerPart = BroadcastDoubles(TranslationTol_mm_Override, nParts, defaultTransTol, "TranslationTol_mm_Override", log, ref ok)
      .Select(v => Math.Max(0.0, Math.Abs(v))).ToList();

    var rotTolPerPart = BroadcastDoubles(RotationTol_deg_Override, nParts, defaultRotTol, "RotationTol_deg_Override", log, ref ok)
      .Select(v => Math.Max(0.0, Math.Abs(v))).ToList();

    var confThrPerPart = BroadcastDoubles(ConfidenceThreshold_Override, nParts, defaultConfThr, "ConfidenceThreshold_Override", log, ref ok)
      .Select(Clamp01).ToList();

    double globalConfThr = confThrPerPart.Max();
    if (confThrPerPart.Any(v => Math.Abs(v - globalConfThr) > 1e-9))
      log.AppendLine("[WARN] ConfidenceThreshold_Override provided per-part, but v0.1 is global. Using MAX=" + globalConfThr.ToString("0.###", CultureInfo.InvariantCulture));

    // Build JSON
    string rawJson = BuildMuseumRawJson(datasetId, AnchorIds, AnchorsModel, AnchorsScan,
      PartIds, nominalLines, scanLines, poseConf, scaleToMm);

    string constraintsJson = BuildConstraintsV01(datasetId, globalConfThr,
      PartIds, allowAxes, maxAbsPerPart, transTolPerPart, rotTolPerPart);

    // Write
    if (Write)
    {
      File.WriteAllText(rawPath, rawJson, new UTF8Encoding(false));
      File.WriteAllText(constraintsPath, constraintsJson, new UTF8Encoding(false));
      log.AppendLine("[OK] Wrote: " + rawPath);
      log.AppendLine("[OK] Wrote: " + constraintsPath);
    }
    else
    {
      log.AppendLine("[INFO] Write=false. Files NOT written.");
      log.AppendLine("[INFO] Would write: " + rawPath);
      log.AppendLine("[INFO] Would write: " + constraintsPath);
    }

    RawJsonPath = rawPath;
    ConstraintsJsonPath = constraintsPath;
    Log = log.ToString();
    Success = true;
  }

  // ============================================================
  // Line coercion (NO Curve.TryGetLine; uses IsLinear + start/end)
  // ============================================================

  private static List<Line> CoerceLines(List<object> items, string label, StringBuilder log, bool requireNonEmpty, ref bool ok)
  {
    var lines = new List<Line>();

    if (items == null || items.Count == 0)
    {
      if (requireNonEmpty)
      {
        ok = false;
        log.AppendLine("[ERROR] " + label + " is empty/unconnected.");
      }
      return lines;
    }

    for (int i = 0; i < items.Count; i++)
    {
      Line ln;
      string reason;
      if (!TryCoerceLine(items[i], out ln, out reason))
      {
        ok = false;
        log.AppendLine("[ERROR] " + label + "[" + i + "] could not be converted to Line. " + reason);
        continue;
      }

      if (!ln.IsValid || ln.Length <= RhinoMath.ZeroTolerance)
      {
        ok = false;
        log.AppendLine("[ERROR] " + label + "[" + i + "] invalid/zero-length after conversion.");
        continue;
      }

      lines.Add(ln);
    }

    if (requireNonEmpty && lines.Count == 0)
    {
      ok = false;
      log.AppendLine("[ERROR] " + label + " contains no valid lines after coercion.");
    }

    return lines;
  }

  private static bool TryCoerceLine(object obj, out Line line, out string reason)
  {
    line = new Line();
    reason = "";

    if (obj == null)
    {
      reason = "Object is null.";
      return false;
    }

    // Unwrap GH wrapper
    object v = obj;
    var ow = obj as GH_ObjectWrapper;
    if (ow != null && ow.Value != null)
      v = ow.Value;

    // GH_Line
    var ghl = v as GH_Line;
    if (ghl != null)
    {
      line = ghl.Value;
      return true;
    }

    // GH_Curve
    var ghc = v as GH_Curve;
    if (ghc != null && ghc.Value != null)
    {
      Line ln;
      if (TryCurveToLine(ghc.Value, out ln))
      {
        line = ln;
        return true;
      }
      reason = "GH_Curve is not linear (cannot convert to Line).";
      return false;
    }

    // Direct Line
    if (v is Line)
    {
      line = (Line)v;
      return true;
    }

    // LineCurve
    var lc = v as LineCurve;
    if (lc != null)
    {
      line = lc.Line;
      return true;
    }

    // Curve
    var c = v as Curve;
    if (c != null)
    {
      Line ln;
      if (TryCurveToLine(c, out ln))
      {
        line = ln;
        return true;
      }
      reason = "Curve is not linear (IsLinear=false).";
      return false;
    }

    // Rhino 8 ModelObject from "Objects" component → reflect Geometry
    try
    {
      var t = v.GetType();
      if (t.FullName != null && t.FullName.IndexOf("ModelObject", StringComparison.OrdinalIgnoreCase) >= 0)
      {
        var prop = t.GetProperty("Geometry") ?? t.GetProperty("GeometryBase");
        if (prop != null)
        {
          var geom = prop.GetValue(v, null);
          if (geom == null)
          {
            reason = "ModelObject.Geometry is null.";
            return false;
          }
          return TryCoerceLine(geom, out line, out reason);
        }

        var m = t.GetMethod("GetGeometry", BindingFlags.Public | BindingFlags.Instance);
        if (m != null)
        {
          var geom = m.Invoke(v, null);
          if (geom == null)
          {
            reason = "ModelObject.GetGeometry() returned null.";
            return false;
          }
          return TryCoerceLine(geom, out line, out reason);
        }

        reason = "ModelObject found but no Geometry/GeometryBase/GetGeometry member.";
        return false;
      }
    }
    catch (Exception ex)
    {
      reason = "Reflection failed: " + ex.Message;
      return false;
    }

    reason = "Unsupported type: " + v.GetType().FullName;
    return false;
  }

  private static bool TryCurveToLine(Curve c, out Line ln)
  {
    ln = new Line();
    if (c == null) return false;

    // exact line curve
    var lc = c as LineCurve;
    if (lc != null)
    {
      ln = lc.Line;
      return true;
    }

    // try polyline
    try
    {
      Polyline pl;
      if (c.TryGetPolyline(out pl) && pl != null && pl.Count >= 2)
      {
        // if it's really linear, start/end is fine
        double tol = GetTol();
        if (c.IsLinear(tol))
        {
          ln = new Line(pl[0], pl[pl.Count - 1]);
          return true;
        }
      }
    }
    catch { }

    // generic linear test
    double t2 = GetTol();
    if (c.IsLinear(t2))
    {
      ln = new Line(c.PointAtStart, c.PointAtEnd);
      return true;
    }

    return false;
  }

  private static double GetTol()
  {
    try
    {
      if (RhinoDoc.ActiveDoc != null)
        return RhinoDoc.ActiveDoc.ModelAbsoluteTolerance;
    }
    catch { }
    return 1e-6;
  }

  // ============================================================
  // Rigid transform (Horn quaternion)
  // ============================================================
  private static Transform ComputeRigidTransform_ModelToScan(List<Point3d> modelPts, List<Point3d> scanPts, out double rms)
  {
    int n = Math.Min(modelPts.Count, scanPts.Count);
    if (n < 3) throw new Exception("Need at least 3 point pairs for rigid transform.");

    // centroids
    Point3d cm = new Point3d(0, 0, 0);
    Point3d cs = new Point3d(0, 0, 0);
    for (int i = 0; i < n; i++)
    {
      cm.X += modelPts[i].X; cm.Y += modelPts[i].Y; cm.Z += modelPts[i].Z;
      cs.X += scanPts[i].X;  cs.Y += scanPts[i].Y;  cs.Z += scanPts[i].Z;
    }
    cm.X /= n; cm.Y /= n; cm.Z /= n;
    cs.X /= n; cs.Y /= n; cs.Z /= n;

    // B = sum (m' * s'^T)
    double b11 = 0, b12 = 0, b13 = 0;
    double b21 = 0, b22 = 0, b23 = 0;
    double b31 = 0, b32 = 0, b33 = 0;

    for (int i = 0; i < n; i++)
    {
      double mx = modelPts[i].X - cm.X;
      double my = modelPts[i].Y - cm.Y;
      double mz = modelPts[i].Z - cm.Z;

      double sx = scanPts[i].X - cs.X;
      double sy = scanPts[i].Y - cs.Y;
      double sz = scanPts[i].Z - cs.Z;

      b11 += mx * sx; b12 += mx * sy; b13 += mx * sz;
      b21 += my * sx; b22 += my * sy; b23 += my * sz;
      b31 += mz * sx; b32 += mz * sy; b33 += mz * sz;
    }

    double tr = b11 + b22 + b33;

    // Horn N matrix (symmetric 4x4)
    double[,] N = new double[4, 4];
    N[0, 0] = tr;        N[0, 1] = b23 - b32; N[0, 2] = b31 - b13; N[0, 3] = b12 - b21;
    N[1, 0] = N[0, 1];   N[1, 1] = b11 - b22 - b33; N[1, 2] = b12 + b21; N[1, 3] = b13 + b31;
    N[2, 0] = N[0, 2];   N[2, 1] = N[1, 2]; N[2, 2] = -b11 + b22 - b33; N[2, 3] = b23 + b32;
    N[3, 0] = N[0, 3];   N[3, 1] = N[1, 3]; N[3, 2] = N[2, 3]; N[3, 3] = -b11 - b22 + b33;

    // Power iteration for dominant eigenvector
    var rng = new Random(12345);
    double[] q = new double[] { rng.NextDouble(), rng.NextDouble(), rng.NextDouble(), rng.NextDouble() };
    Normalize4(q);

    for (int iter = 0; iter < 60; iter++)
    {
      double[] q2 = new double[4];
      for (int r = 0; r < 4; r++)
      {
        double s = 0;
        for (int c = 0; c < 4; c++) s += N[r, c] * q[c];
        q2[r] = s;
      }
      Normalize4(q2);
      q = q2;
    }

    // q = [qw, qx, qy, qz]
    double qw = q[0], qx = q[1], qy = q[2], qz = q[3];

    // Rotation matrix from quaternion (w,x,y,z)
    double r00 = 1 - 2 * (qy * qy + qz * qz);
    double r01 = 2 * (qx * qy - qz * qw);
    double r02 = 2 * (qx * qz + qy * qw);

    double r10 = 2 * (qx * qy + qz * qw);
    double r11 = 1 - 2 * (qx * qx + qz * qz);
    double r12 = 2 * (qy * qz - qx * qw);

    double r20 = 2 * (qx * qz - qy * qw);
    double r21 = 2 * (qy * qz + qx * qw);
    double r22 = 1 - 2 * (qx * qx + qy * qy);

    // t = cs - R*cm
    double tx = cs.X - (r00 * cm.X + r01 * cm.Y + r02 * cm.Z);
    double ty = cs.Y - (r10 * cm.X + r11 * cm.Y + r12 * cm.Z);
    double tz = cs.Z - (r20 * cm.X + r21 * cm.Y + r22 * cm.Z);

    Transform T = Transform.Identity;
    T.M00 = r00; T.M01 = r01; T.M02 = r02; T.M03 = tx;
    T.M10 = r10; T.M11 = r11; T.M12 = r12; T.M13 = ty;
    T.M20 = r20; T.M21 = r21; T.M22 = r22; T.M23 = tz;
    T.M30 = 0;   T.M31 = 0;   T.M32 = 0;   T.M33 = 1;

    // RMS
    double sumSq = 0.0;
    for (int i = 0; i < n; i++)
    {
      Point3d p = modelPts[i];
      p.Transform(T);
      double dx = p.X - scanPts[i].X;
      double dy = p.Y - scanPts[i].Y;
      double dz = p.Z - scanPts[i].Z;
      sumSq += dx * dx + dy * dy + dz * dz;
    }
    rms = Math.Sqrt(sumSq / n);

    return T;
  }

  private static void Normalize4(double[] v)
  {
    double n = Math.Sqrt(v[0] * v[0] + v[1] * v[1] + v[2] * v[2] + v[3] * v[3]);
    if (n <= 1e-12) { v[0] = 1; v[1] = 0; v[2] = 0; v[3] = 0; return; }
    v[0] /= n; v[1] /= n; v[2] /= n; v[3] /= n;
  }

  // ============================================================
  // Broadcast + IDs
  // ============================================================
  private static List<double> BroadcastDoubles(List<double> src, int n, double def, string label, StringBuilder log, ref bool ok)
  {
    src = src ?? new List<double>();
    if (n <= 0) return new List<double>();

    if (src.Count == 0) return Enumerable.Repeat(def, n).ToList();
    if (src.Count == 1) return Enumerable.Repeat(src[0], n).ToList();
    if (src.Count == n) return new List<double>(src);

    ok = false;
    log.AppendLine("[ERROR] " + label + " must be empty, length 1, or length " + n + ". Got " + src.Count + ".");
    return Enumerable.Repeat(def, n).ToList();
  }

  private static List<Vector3d> BroadcastVectors(List<Vector3d> src, int n, Vector3d def, string label, StringBuilder log, ref bool ok)
  {
    src = src ?? new List<Vector3d>();
    if (n <= 0) return new List<Vector3d>();

    if (src.Count == 0) return Enumerable.Repeat(def, n).ToList();
    if (src.Count == 1) return Enumerable.Repeat(src[0], n).ToList();
    if (src.Count == n) return new List<Vector3d>(src);

    ok = false;
    log.AppendLine("[ERROR] " + label + " must be empty, length 1, or length " + n + ". Got " + src.Count + ".");
    return Enumerable.Repeat(def, n).ToList();
  }

  private static bool EnsureUniqueNonEmpty(List<string> ids, string label, StringBuilder log)
  {
    bool ok = true;
    var seen = new HashSet<string>(StringComparer.OrdinalIgnoreCase);

    for (int i = 0; i < ids.Count; i++)
    {
      string s = (ids[i] ?? "").Trim();
      ids[i] = s;

      if (string.IsNullOrWhiteSpace(s))
      {
        ok = false;
        log.AppendLine("[ERROR] " + label + "[" + i + "] is empty.");
        continue;
      }
      if (!seen.Add(s))
      {
        ok = false;
        log.AppendLine("[ERROR] Duplicate " + label + ": '" + s + "'");
      }
    }
    return ok;
  }

  private static double Clamp01(double v)
  {
    if (v < 0.0) return 0.0;
    if (v > 1.0) return 1.0;
    return v;
  }

  // ============================================================
  // JSON builders
  // ============================================================
  private static string BuildMuseumRawJson(
    string datasetId,
    List<string> anchorIds,
    List<Point3d> modelPts,
    List<Point3d> scanPts,
    List<string> partIds,
    List<Line> nominalLines,
    List<Line> scanLines,
    List<double> poseConfidence,
    double scaleToMm)
  {
    var sb = new StringBuilder(4096);
    sb.AppendLine("{");
    sb.AppendLine("  \"dataset_id\": " + J(datasetId) + ",");
    sb.AppendLine("  \"anchors\": [");

    for (int i = 0; i < anchorIds.Count; i++)
    {
      sb.AppendLine("    {");
      sb.AppendLine("      \"anchor_id\": " + J(anchorIds[i]) + ",");
      sb.AppendLine("      \"model_xyz_mm\": " + Pt(modelPts[i], scaleToMm) + ",");
      sb.AppendLine("      \"scan_xyz_mm\": " + Pt(scanPts[i], scaleToMm));
      sb.Append("    }");
      sb.AppendLine(i < anchorIds.Count - 1 ? "," : "");
    }

    sb.AppendLine("  ],");
    sb.AppendLine("  \"parts\": [");

    for (int i = 0; i < partIds.Count; i++)
    {
      sb.AppendLine("    {");
      sb.AppendLine("      \"part_id\": " + J(partIds[i]) + ",");
      sb.AppendLine("      \"nominal_line_mm\": " + LineObj(nominalLines[i], scaleToMm) + ",");
      sb.AppendLine("      \"scan_line_mm\": " + LineObj(scanLines[i], scaleToMm) + ",");
      sb.AppendLine("      \"pose_confidence\": " + Num(poseConfidence[i]));
      sb.Append("    }");
      sb.AppendLine(i < partIds.Count - 1 ? "," : "");
    }

    sb.AppendLine("  ]");
    sb.AppendLine("}");
    return sb.ToString();
  }

  private static string BuildConstraintsV01(
    string datasetId,
    double globalConfidenceThreshold,
    List<string> partIds,
    List<Vector3d> allowedTranslationAxes,
    List<Vector3d> translationMaxAbsMm,
    List<double> translationTolMm,
    List<double> rotationTolDeg)
  {
    var sb = new StringBuilder(4096);

    sb.AppendLine("{");
    sb.AppendLine("  \"schema_version\": \"v0.1\",");
    sb.AppendLine("  \"dataset_id\": " + J(datasetId) + ",");
    sb.AppendLine("  \"engine_config\": {");
    sb.AppendLine("    \"confidence_threshold\": " + Num(Clamp01(globalConfidenceThreshold)) + ",");
    sb.AppendLine("    \"translation_clamp_policy\": \"per_axis_max_abs\"");
    sb.AppendLine("  },");
    sb.AppendLine("  \"parts\": [");

    for (int i = 0; i < partIds.Count; i++)
    {
      bool ax = allowedTranslationAxes[i].X > 0.5;
      bool ay = allowedTranslationAxes[i].Y > 0.5;
      bool az = allowedTranslationAxes[i].Z > 0.5;

      Vector3d m = translationMaxAbsMm[i];

      sb.AppendLine("    {");
      sb.AppendLine("      \"part_id\": " + J(partIds[i]) + ",");
      sb.AppendLine("      \"allowed_translation_axes\": { \"x\": " + B(ax) + ", \"y\": " + B(ay) + ", \"z\": " + B(az) + " },");
      sb.AppendLine("      \"rotation_mode\": \"fixed\",");
      sb.AppendLine("      \"allowed_rotation_axes\": { \"x\": false, \"y\": false, \"z\": false },");
      sb.AppendLine("      \"translation_max_abs_mm\": { \"x\": " + Num(m.X) + ", \"y\": " + Num(m.Y) + ", \"z\": " + Num(m.Z) + " },");
      sb.AppendLine("      \"rotation_max_abs_deg\": { \"x\": 0.0, \"y\": 0.0, \"z\": 0.0 },");
      sb.AppendLine("      \"tolerances\": { \"translation_mm\": " + Num(translationTolMm[i]) + ", \"rotation_deg\": " + Num(rotationTolDeg[i]) + " }");
      sb.Append("    }");
      sb.AppendLine(i < partIds.Count - 1 ? "," : "");
    }

    sb.AppendLine("  ]");
    sb.AppendLine("}");
    return sb.ToString();
  }

  // ============================================================
  // JSON formatting
  // ============================================================
  private static string Num(double v)
  {
    double r = Math.Round(v, NUM_DECIMALS);
    double eps = 0.5 * Math.Pow(10.0, -NUM_DECIMALS);
    if (Math.Abs(r) < eps) r = 0.0;
    string fmt = "0." + new string('0', NUM_DECIMALS);
    return r.ToString(fmt, CultureInfo.InvariantCulture);
  }

  private static string B(bool v) { return v ? "true" : "false"; }

  private static string Pt(Point3d p, double sToMm)
  {
    return "[" + Num(p.X * sToMm) + ", " + Num(p.Y * sToMm) + ", " + Num(p.Z * sToMm) + "]";
  }

  private static string LineObj(Line ln, double sToMm)
  {
    return "{ \"p0\": " + Pt(ln.From, sToMm) + ", \"p1\": " + Pt(ln.To, sToMm) + " }";
  }

  private static string J(string s)
  {
    if (s == null) s = "";
    var sb = new StringBuilder();
    sb.Append('\"');
    foreach (char c in s)
    {
      switch (c)
      {
        case '\\': sb.Append("\\\\"); break;
        case '\"': sb.Append("\\\""); break;
        case '\b': sb.Append("\\b"); break;
        case '\f': sb.Append("\\f"); break;
        case '\n': sb.Append("\\n"); break;
        case '\r': sb.Append("\\r"); break;
        case '\t': sb.Append("\\t"); break;
        default:
          if (c < 32) sb.Append("\\u" + ((int)c).ToString("x4"));
          else sb.Append(c);
          break;
      }
    }
    sb.Append('\"');
    return sb.ToString();
  }
}
# ---------- end c_script ----------
panel_2 = Panel(c_script.out)
panel_3 = Panel(c_script.ConstraintsJsonPath)
panel_4 = Panel(c_script.Log)
panel_5 = Panel(c_script.RawJsonPath)
panel_6 = Panel(c_script.Success)
